# Grasshopper definition GrasshopperTests.gh (Grasshopper 1.0.7)
# plug-ins: Pterodactyl, Brontosaurus, Megarachne

number_slider = Slider(10, range=0..10)  # disabled
number_slider_2 = Slider(10, range=0..20)  # disabled
number_slider_3 = Slider(5, range=0..10)  # disabled
number_slider_4 = Slider(5, range=0..10)  # disabled
toggle = BooleanToggle(True)  # disabled
pt = ConstructPoint(XCoordinate=number_slider_3, YCoordinate=number_slider_2, ZCoordinate=0)  # disabled
pt_2 = ConstructPoint(XCoordinate=number_slider, YCoordinate=0, ZCoordinate=0)  # disabled
pt_3 = ConstructPoint(XCoordinate=0, YCoordinate=0, ZCoordinate=0)  # disabled
pt_4 = ConstructPoint(XCoordinate=0, YCoordinate=0, ZCoordinate=0)  # disabled
pt_5 = ConstructPoint(XCoordinate=number_slider_3, YCoordinate=number_slider_4, ZCoordinate=0)  # disabled
two_points_to_graph_part = TwoPointsToGraphPart(PointA=pt_5, PointB=pt, IsDirected=toggle)  # disabled
two_points_to_graph_part_2 = TwoPointsToGraphPart(PointA=pt_4, PointB=pt_5, IsDirected=toggle)  # disabled
two_points_to_graph_part_3 = TwoPointsToGraphPart(PointA=pt_2, PointB=pt_5, IsDirected=toggle)  # disabled
two_points_to_graph_part_4 = TwoPointsToGraphPart(PointA=pt_3, PointB=pt_2, IsDirected=toggle)  # disabled
create_graph = CreateGraph(
    GraphParts=[two_points_to_graph_part_4, two_points_to_graph_part_2, two_points_to_graph_part_3, two_points_to_graph_part],
    Tolerance=0.0001)  # disabled
toggle_2 = BooleanToggle(False)  # disabled
deconstruct_graph = DeconstructGraph(Graph=create_graph)  # -> GraphArray, Vertices, Edges, AdjacencyList; disabled
lng = ListLength(List=deconstruct_graph.Vertices)  # disabled
series = Series(Start=0, Step=1, Count=lng)  # disabled
bfs_search = BFSSearch(Graph=create_graph, StartVertexIndex=0, KeepSearching=toggle_2)  # -> Visited, PreviousArray; disabled
tag = TextTag3D(Location=deconstruct_graph.Vertices, Text=series, Size=1, Justification=7)  # disabled
pt_6 = Point(bfs_search.Visited)  # disabled
crv = Curve(deconstruct_graph.Edges)  # disabled
panel = Panel(bfs_search.PreviousArray)  # disabled
calendar = Calendar()

# ----
# Vector To Graph Part
number_slider_5 = Slider(5, range=0..10)
panel_2 = Panel("VectorToGraphPartMilimeters_VectorTrue_DeconstructIsDirected")
pt_7 = ConstructPoint(XCoordinate=Slider(4, range=0..10), YCoordinate=number_slider_5, ZCoordinate=0)
vec = VectorXYZ(XComponent=Slider(2, range=0..10), YComponent=Slider(3, range=0..10), ZComponent=0)  # -> Vector, Length
pt_8 = ConstructPoint(XCoordinate=Slider(4, range=0..10), YCoordinate=Slider(5, range=0..10), ZCoordinate=0)
vec_2 = VectorXYZ(XComponent=Slider(2, range=0..10), YComponent=Slider(3, range=0..10), ZComponent=0)  # -> Vector, Length
vector_to_graph_part = VectorToGraphPart(Vector=vec.Vector, Point=pt_7, IsDirected=Toggle(True))
vector_to_graph_part_2 = VectorToGraphPart(Vector=vec_2.Vector, Point=pt_8, IsDirected=Toggle(True))
deconstruct_graph_part = DeconstructGraphPart(GraphPart=vector_to_graph_part)  # -> Vertices, Edge, IsDirected, Weight
txt = Text("""Graph Part
Is Directed: True
Edge Weight: 3.60555127546399""")
divide = DivideCurve(Curve=deconstruct_graph_part.Edge, Count=10, Kinks=False)  # -> Points, Tangents, Parameters
pt_9 = Point([Point(4, 5, 0), Point(6, 8, 0)])
assert = Assert(TestNames="VectorToGraphPartMilimeters_VectorTrue_String", Expected=txt, Actual=vector_to_graph_part_2)  # -> Result, FailedInfo
bool = Boolean(True)
num = Number(3.605551275)
pt_10 = Point([Point(4, 5, 0), Point(4.2, 5.3, 0), Point(4.4, 5.6, 0), Point(4.6, 5.9, 0), Point(4.8, 6.2, 0), Point(5, 6.5, 0), Point(5.2, 6.8, 0), Point(5.4, 7.1, 0), Point(5.6, 7.4, 0), Point(5.8, 7.7, 0), Point(6, 8, 0)])
assert_point_list = AssertPointList(
    TestName="VectorToGraphPartMilimeters_VectorTrue_DeconstructVertices",
    ExpectedPointList=pt_9,
    ActualPointList=deconstruct_graph_part.Vertices,
    Tolerance="0.0001")  # -> Result, FailedInfo
assert_2 = Assert(TestNames=panel_2, Expected=bool, Actual=deconstruct_graph_part.IsDirected)  # -> Result, FailedInfo
assert_3 = Assert(TestNames="VectorToGraphPartMilimeters_VectorTrue_DeconstructWeight", Expected=num, Actual=deconstruct_graph_part.Weight)  # -> Result, FailedInfo
assert_point_list_2 = AssertPointList(
    TestName="VectorToGraphPartMilimeters_VectorTrue_DeconstructEdges",
    ExpectedPointList=pt_10,
    ActualPointList=divide.Points,
    Tolerance="0.0001")  # -> Result, FailedInfo
entwine = Entwine(
    Branch00=assert.Result,
    Branch01=assert_point_list.Result,
    Branch02=assert_point_list_2.Result,
    Branch03=assert_2.Result,
    Branch04=assert_3.Result,
    FlattenInputs=True)  # -> flatten(Result)

# ----
# Two Points To Graph Part
number_slider_6 = Slider(3, range=0..10)
panel_3 = Panel("TwoPointsToGraphPartMilimeters_TwoPointsTrue_DeconstructVertices")
panel_4 = Panel("TwoPointsToGraphPartMilimeters_TwoPointsTrue_DeconstructIsDirected")
panel_5 = Panel("TwoPointsToGraphPartMilimeters_TwoPointsTrue_DeconstructEdges")
pt_11 = ConstructPoint(XCoordinate=Slider(5, range=0..10), YCoordinate=number_slider_6, ZCoordinate=0)
pt_12 = ConstructPoint(XCoordinate=0, YCoordinate=0, ZCoordinate=0)
pt_13 = ConstructPoint(XCoordinate=Slider(10, range=0..10), YCoordinate=Slider(3, range=0..10), ZCoordinate=0)
pt_14 = ConstructPoint(XCoordinate=0, YCoordinate=0, ZCoordinate=0)
panel_6 = Panel("TwoPointsToGraphPartMilimeters_TwoPointsTrue_DeconstructWeight")
two_points_to_graph_part_5 = TwoPointsToGraphPart(PointA=pt_12, PointB=pt_11, IsDirected=True)
two_points_to_graph_part_6 = TwoPointsToGraphPart(PointA=pt_14, PointB=pt_13, IsDirected=Toggle(False))
txt_2 = Text("""Graph Part
Is Directed: True
Edge Weight: 5.8309518948453""")
deconstruct_graph_part_2 = DeconstructGraphPart(GraphPart=two_points_to_graph_part_6)  # -> Vertices, Edge, IsDirected, Weight
assert_4 = Assert(TestNames="TwoPointsToGraphPartMilimeters_TwoPointsTrue_String", Expected=txt_2, Actual=two_points_to_graph_part_5)  # -> Result, FailedInfo
divide_2 = DivideCurve(Curve=deconstruct_graph_part_2.Edge, Count=10, Kinks=False)  # -> Points, Tangents, Parameters
pt_15 = Point([Point(0, 0, 0), Point(10, 3, 0)])
bool_2 = Boolean(False)
num_2 = Number(10.44030651)
pt_16 = Point([Point(0, 0, 0), Point(1, 0.3, 0), Point(2, 0.6, 0), Point(3, 0.9, 0), Point(4, 1.2, 0), Point(5, 1.5, 0), Point(6, 1.8, 0), Point(7, 2.1, 0), Point(8, 2.4, 0), Point(9, 2.7, 0), Point(10, 3, 0)])
assert_point_list_3 = AssertPointList(TestName=panel_3, ExpectedPointList=pt_15, ActualPointList=deconstruct_graph_part_2.Vertices, Tolerance="0.0001")  # -> Result, FailedInfo
assert_5 = Assert(TestNames=panel_4, Expected=bool_2, Actual=deconstruct_graph_part_2.IsDirected)  # -> Result, FailedInfo
assert_6 = Assert(TestNames=panel_6, Expected=num_2, Actual=deconstruct_graph_part_2.Weight)  # -> Result, FailedInfo
assert_point_list_4 = AssertPointList(TestName=panel_5, ExpectedPointList=pt_16, ActualPointList=divide_2.Points, Tolerance="0.0001")  # -> Result, FailedInfo
entwine_2 = Entwine(
    Branch00=assert_4.Result,
    Branch01=assert_point_list_3.Result,
    Branch02=assert_point_list_4.Result,
    Branch03=assert_5.Result,
    Branch04=assert_6.Result,
    FlattenInputs=True)  # -> flatten(Result)

# ----
# Curve To Graph Part
# Get Graph Degree
# Get Vertex Degree
# BFS Is Graph Connected
# BFS Search
panel_7 = Panel("CurveToGraphPartMilimeters_NurbsCurveTrue_DeconstructVertices")
nurbs = NurbsCurve(
    Vertices=[Point(-23.10995343, -7.195870574, 0), Point(-6.749057302, 4.935678258, 0), Point(9.834436056, 5.492171323, 0), Point(21.74338766, -9.310544224, 0), Point(31.31506839, 2.487108769, 0)],
    Degree=3,
    Periodic=False)  # -> Curve, Length, Domain
nurbs_2 = NurbsCurve(
    Vertices=[Point(-23.10995343, -7.195870574, 0), Point(-6.749057302, 4.935678258, 0), Point(9.834436056, 5.492171323, 0), Point(21.74338766, -9.310544224, 0), Point(31.31506839, 2.487108769, 0)],
    Degree=3,
    Periodic=False)  # -> Curve, Length, Domain
nurbs_3 = NurbsCurve(
    Vertices=[Point(-23.10995343, -7.195870574, 0), Point(-6.749057302, 4.935678258, 0), Point(9.834436056, 5.492171323, 0), Point(21.74338766, -9.310544224, 0), Point(31.31506839, 2.487108769, 0)],
    Degree=3,
    Periodic=False)  # -> Curve, Length, Domain
panel_8 = Panel("CurveToGraphPartMilimeters_NurbsCurveFalse_DeconstructIsDirected")
nurbs_4 = NurbsCurve(
    Vertices=[Point(-23.10995343, -7.195870574, 0), Point(-6.749057302, 4.935678258, 0), Point(9.834436056, 5.492171323, 0), Point(21.74338766, -9.310544224, 0), Point(31.31506839, 2.487108769, 0)],
    Degree=3,
    Periodic=False)  # -> Curve, Length, Domain
panel_9 = Panel("CurveToGraphPartMilimeters_NurbsCurveTrue_DeconstructIsDirected")
panel_10 = Panel("CurveToGraphPartMilimeters_NurbsCurveTrue_DeconstructWeight")
cir = Circle(Plane=PlaneXY(0, 0, 0), Radius=1)
crv_2 = Curve(nurbs.Curve)
crv_3 = Curve(nurbs_2.Curve)
crv_4 = Curve(nurbs_3.Curve)
crv_5 = Curve(nurbs_4.Curve)
curve_to_graph_part = CurveToGraphPart(Curve=crv_2, IsDirected=Toggle(False))
curve_to_graph_part_2 = CurveToGraphPart(Curve=crv_3, IsDirected=Toggle(True))
curve_to_graph_part_3 = CurveToGraphPart(Curve=crv_4, IsDirected=Toggle(True))
curve_to_graph_part_4 = CurveToGraphPart(Curve=cir, IsDirected=True)
curve_to_graph_part_5 = CurveToGraphPart(Curve=crv_5, IsDirected=Toggle(False))
txt_3 = Text("""Graph Part
Is Directed: False
Edge Weight: 61.1190340271855""")
txt_4 = Text("""Graph Part
Is Directed: True
Edge Weight: 61.1190340271855""")
deconstruct_graph_part_3 = DeconstructGraphPart(GraphPart=curve_to_graph_part_3)  # -> Vertices, Edge, IsDirected, Weight
deconstruct_graph_part_4 = DeconstructGraphPart(GraphPart=curve_to_graph_part_4)  # -> Vertices, Edge, IsDirected, Weight
# Naming convencion:
# ComponentNameUnits_Input_Output
assert_7 = Assert(TestNames="CurveToGraphPartMilimeters_NurbsCurveFalse_String", Expected=txt_3, Actual=curve_to_graph_part)  # -> Result, FailedInfo
assert_8 = Assert(TestNames="CurveToGraphPartMilimeters_NurbsCurveTrue_String", Expected=txt_4, Actual=curve_to_graph_part_2)  # -> Result, FailedInfo
deconstruct_graph_part_5 = DeconstructGraphPart(GraphPart=curve_to_graph_part_5)  # -> Vertices, Edge, IsDirected, Weight
divide_3 = DivideCurve(Curve=deconstruct_graph_part_3.Edge, Count=10, Kinks=False)  # -> Points, Tangents, Parameters
pt_17 = Point([Point(-23.10995343, -7.195870574, 0), Point(31.31506839, 2.487108769, 0)])
divide_4 = DivideCurve(Curve=deconstruct_graph_part_4.Edge, Count=10, Kinks=False)  # -> Points, Tangents, Parameters
bool_3 = Boolean(True)
pt_18 = Point([Point(-23.10995343, -7.195870574, 0), Point(-18.10725183, -3.686083312, 0), Point(-12.87478231, -0.5310599797, 0), Point(-7.331270421, 2.031000878, 0), Point(-1.418094952, 3.516607478, 0), Point(4.650486706, 3.159345084, 0), Point(10.26149537, 0.7897934307, 0), Point(15.52763009, -2.31038664, 0), Point(21.3516931, -3.926966628, 0), Point(26.9782872, -1.796066674, 0), Point(31.31506839, 2.487108769, 0)])
num_3 = Number(61.11903403)
pt_19 = Point([Point(1, 0, 0), Point(1, 0, 0)])
assert_point_list_5 = AssertPointList(TestName=panel_7, ExpectedPointList=pt_17, ActualPointList=deconstruct_graph_part_3.Vertices, Tolerance="0.0001")  # -> Result, FailedInfo
pt_20 = Point([Point(1, 0, 0), Point(0.8090169933, 0.5877852537, 0), Point(0.3090169582, 0.9510565281, 0), Point(-0.3090169866, 0.9510565188, 0), Point(-0.809016997, 0.5877852487, 0), Point(-1, 0, 0), Point(-0.8090169933, -0.5877852537, 0), Point(-0.3090169582, -0.9510565281, 0), Point(0.3090169866, -0.9510565188, 0), Point(0.809016997, -0.5877852487, 0)])
bool_4 = Boolean(False)
assert_9 = Assert(TestNames=panel_9, Expected=bool_3, Actual=deconstruct_graph_part_3.IsDirected)  # -> Result, FailedInfo
assert_10 = Assert(TestNames=panel_10, Expected=num_3, Actual=deconstruct_graph_part_3.Weight)  # -> Result, FailedInfo
assert_point_list_6 = AssertPointList(
    TestName="CurveToGraphPartMilimeters_NurbsCurveTrue_DeconstructEdges",
    ExpectedPointList=pt_18,
    ActualPointList=divide_3.Points,
    Tolerance="0.0001")  # -> Result, FailedInfo
assert_point_list_7 = AssertPointList(
    TestName="CurveToGraphPartMilimeters_Circle_DeconstructVertices",
    ExpectedPointList=pt_19,
    ActualPointList=deconstruct_graph_part_4.Vertices,
    Tolerance="0.0001")  # -> Result, FailedInfo
assert_11 = Assert(TestNames=panel_8, Expected=bool_4, Actual=deconstruct_graph_part_5.IsDirected)  # -> Result, FailedInfo
assert_point_list_8 = AssertPointList(
    TestName="CurveToGraphPartMilimeters_Circle_DeconstructEdges",
    ExpectedPointList=pt_20,
    ActualPointList=divide_4.Points,
    Tolerance="0.0001")  # -> Result, FailedInfo
entwine_3 = Entwine(
    Branch00=assert_7.Result,
    Branch01=assert_8.Result,
    Branch02=assert_point_list_5.Result,
    Branch03=assert_point_list_6.Result,
    Branch04=assert_9.Result,
    Branch05=assert_10.Result,
    Branch06=assert_11.Result,
    Branch07=assert_point_list_7.Result,
    Branch08=assert_point_list_8.Result,
    FlattenInputs=True)  # -> flatten(Result)

# ----
# Create Graph
number_slider_7 = Slider(10, range=0..10)
number_slider_8 = Slider(5, range=0..10)
pt_21 = ConstructPoint(XCoordinate=0, YCoordinate=0, ZCoordinate=0)
pt_22 = ConstructPoint(XCoordinate=number_slider_7, YCoordinate=0, ZCoordinate=0)
pt_23 = ConstructPoint(XCoordinate=0, YCoordinate=0, ZCoordinate=0)
pt_24 = ConstructPoint(XCoordinate=Slider(10, range=0..10), YCoordinate=0, ZCoordinate=0)
toggle_3 = BooleanToggle(True)
toggle_4 = BooleanToggle(True)
two_points_to_graph_part_7 = TwoPointsToGraphPart(PointA=pt_21, PointB=pt_22, IsDirected=Toggle(True))
pt_25 = ConstructPoint(XCoordinate=0, YCoordinate=0, ZCoordinate=0)
pt_26 = ConstructPoint(XCoordinate=Slider(10, range=0..10), YCoordinate=0, ZCoordinate=0)
pt_27 = ConstructPoint(XCoordinate=0, YCoordinate=0, ZCoordinate=0)
pt_28 = ConstructPoint(XCoordinate=Slider(10, range=0..10), YCoordinate=Slider(5, range=0..10), ZCoordinate=0)
pt_29 = ConstructPoint(XCoordinate=0, YCoordinate=0, ZCoordinate=0)
pt_30 = ConstructPoint(XCoordinate=Slider(10, range=0..10), YCoordinate=0, ZCoordinate=0)
pt_31 = ConstructPoint(XCoordinate=0, YCoordinate=number_slider_8, ZCoordinate=0)
pt_32 = ConstructPoint(XCoordinate=Slider(10, range=0..10), YCoordinate=number_slider_8, ZCoordinate=0)
two_points_to_graph_part_8 = TwoPointsToGraphPart(PointA=pt_23, PointB=pt_24, IsDirected=Toggle(False))
toggle_5 = BooleanToggle(True)
two_points_to_graph_part_9 = TwoPointsToGraphPart(PointA=pt_27, PointB=pt_28, IsDirected=toggle_3)
two_points_to_graph_part_10 = TwoPointsToGraphPart(PointA=pt_31, PointB=pt_32, IsDirected=toggle_4)
two_points_to_graph_part_11 = TwoPointsToGraphPart(PointA=pt_25, PointB=pt_26, IsDirected=toggle_3)
two_points_to_graph_part_12 = TwoPointsToGraphPart(PointA=pt_29, PointB=pt_30, IsDirected=toggle_4)
pt_33 = ConstructPoint(XCoordinate=0, YCoordinate=0, ZCoordinate=0)
pt_34 = ConstructPoint(XCoordinate=Slider(10, range=0..10), YCoordinate=0, ZCoordinate=0)
pt_35 = ConstructPoint(XCoordinate=0, YCoordinate=0, ZCoordinate=0)
pt_36 = ConstructPoint(XCoordinate=Slider(5, range=0..10), YCoordinate=Slider(5, range=0..10), ZCoordinate=0)
create_graph_2 = CreateGraph(GraphParts=two_points_to_graph_part_7, Tolerance=0.0001)
create_graph_3 = CreateGraph(GraphParts=two_points_to_graph_part_8, Tolerance=0.0001)
deconstruct_graph_2 = DeconstructGraph(Graph=create_graph_3)  # -> GraphArray, Vertices, Edges, AdjacencyList
deconstruct_graph_3 = DeconstructGraph(Graph=create_graph_2)  # -> GraphArray, Vertices, Edges, AdjacencyList
two_points_to_graph_part_13 = TwoPointsToGraphPart(PointA=pt_35, PointB=pt_36, IsDirected=toggle_5)
two_points_to_graph_part_14 = TwoPointsToGraphPart(PointA=pt_34, PointB=pt_36, IsDirected=toggle_5)
two_points_to_graph_part_15 = TwoPointsToGraphPart(PointA=pt_33, PointB=pt_34, IsDirected=toggle_5)
crv_6 = Curve(deconstruct_graph_3.Edges)
crv_7 = Curve(deconstruct_graph_2.Edges)
panel_11 = Panel(deconstruct_graph_3.AdjacencyList)
panel_12 = Panel(deconstruct_graph_2.AdjacencyList)
create_graph_4 = CreateGraph(GraphParts=[two_points_to_graph_part_11, two_points_to_graph_part_9], Tolerance=0.0001)
deconstruct_graph_4 = DeconstructGraph(Graph=create_graph_4)  # -> GraphArray, Vertices, Edges, AdjacencyList
crv_8 = Curve(deconstruct_graph_4.Edges)
panel_13 = Panel(deconstruct_graph_4.AdjacencyList)
create_graph_5 = CreateGraph(GraphParts=[two_points_to_graph_part_12, two_points_to_graph_part_10], Tolerance=0.0001)
deconstruct_graph_5 = DeconstructGraph(Graph=create_graph_5)  # -> GraphArray, Vertices, Edges, AdjacencyList
divide_5 = DivideCurve(Curve=crv_8, Count=10, Kinks=False)  # -> flatten(Points), Tangents, Parameters
txt_5 = Text("""Graph
Vertices: 2
Edges: 1""")
divide_6 = DivideCurve(Curve=crv_7, Count=10, Kinks=False)  # -> flatten(Points), Tangents, Parameters
divide_7 = DivideCurve(Curve=crv_6, Count=10, Kinks=False)  # -> Points, Tangents, Parameters
txt_6 = Text("""Graph
Vertices: 2
Edges: 2""")
panel_14 = Panel(deconstruct_graph_3.GraphArray)
panel_15 = Panel(deconstruct_graph_4.GraphArray)
txt_7 = Text("0;1")
txt_8 = Text(["0;1", "0;2"])
panel_16 = Panel(deconstruct_graph_2.GraphArray)
txt_9 = Text("""Graph
Vertices: 3
Edges: 2""")
txt_10 = Text(["1;", ""])
txt_11 = Text(["1;2;", "", ""])
crv_9 = Curve(deconstruct_graph_5.Edges)
txt_12 = Text(["0;1", "1;0"])
pt_37 = Point([Point(0, 0, 0), Point(10, 0, 0), Point(10, 5, 0)])
txt_13 = Text("""Graph
Vertices: 4
Edges: 2""")
pt_38 = Point([Point(0, 0, 0), Point(10, 0, 0)])
txt_14 = Text(["1;", "0;"])
pt_39 = Point([Point(0, 0, 0), Point(10, 0, 0)])
pt_40 = Point([Point(0, 0, 0), Point(1, 0, 0), Point(2, 0, 0), Point(3, 0, 0), Point(4, 0, 0), Point(5, 0, 0), Point(6, 0, 0), Point(7, 0, 0), Point(8, 0, 0), Point(9, 0, 0), Point(10, 0, 0)])
pt_41 = Point([Point(0, 0, 0), Point(1, 0, 0), Point(2, 0, 0), Point(3, 0, 0), Point(4, 0, 0), Point(5, 0, 0), Point(6, 0, 0), Point(7, 0, 0), Point(8, 0, 0), Point(9, 0, 0), Point(10, 0, 0), Point(0, 0, 0), Point(1, 0.5, 0), Point(2, 1, 0), Point(3, 1.5, 0), Point(4, 2, 0), Point(5, 2.5, 0), Point(6, 3, 0), Point(7, 3.5, 0), Point(8, 4, 0), Point(9, 4.5, 0), Point(10, 5, 0)])
panel_17 = Panel(deconstruct_graph_5.AdjacencyList)
pt_42 = Point([Point(0, 0, 0), Point(1, 0, 0), Point(2, 0, 0), Point(3, 0, 0), Point(4, 0, 0), Point(5, 0, 0), Point(6, 0, 0), Point(7, 0, 0), Point(8, 0, 0), Point(9, 0, 0), Point(10, 0, 0), Point(10, 0, 0), Point(9, 0, 0), Point(8, 0, 0), Point(7, 0, 0), Point(6, 0, 0), Point(5, 0, 0), Point(4, 0, 0), Point(3, 0, 0), Point(2, 0, 0), Point(1, 0, 0), Point(0, 0, 0)])
assert_12 = Assert(TestNames="CreateGraphMilimeters_1GraphPart_String", Expected=txt_5, Actual=create_graph_2)  # -> Result, FailedInfo
assert_13 = Assert(TestNames="CreateGraphMilimeters_1GraphPartUndirected_String", Expected=txt_6, Actual=create_graph_3)  # -> Result, FailedInfo
divide_8 = DivideCurve(Curve=crv_9, Count=10, Kinks=False)  # -> flatten(Points), Tangents, Parameters
create_graph_6 = CreateGraph(GraphParts=[two_points_to_graph_part_15, two_points_to_graph_part_13, two_points_to_graph_part_14], Tolerance=0.0001)
deconstruct_graph_6 = DeconstructGraph(Graph=create_graph_6)  # -> GraphArray, Vertices, Edges, AdjacencyList
crv_10 = Curve(deconstruct_graph_6.Edges)
panel_18 = Panel(deconstruct_graph_6.AdjacencyList)
divide_9 = DivideCurve(Curve=crv_10, Count=10, Kinks=False)  # -> flatten(Points), Tangents, Parameters
assert_list = AssertList(TestName="CreateGraphMilimeters_2GraphParts_GraphArray", ExpectedList=txt_8, ActualList=panel_15)  # -> Result, FailedInfo
assert_point_list_9 = AssertPointList(
    TestName="CreateGraphMilimeters_2GraphParts_Edge",
    ExpectedPointList=pt_41,
    ActualPointList=divide_5.Points,
    Tolerance="0.0001")  # -> Result, FailedInfo
assert_point_list_10 = AssertPointList(
    TestName="CreateGraphMilimeters_2GraphParts_Vertices",
    ExpectedPointList=pt_37,
    ActualPointList=deconstruct_graph_4.Vertices,
    Tolerance="0.0001")  # -> Result, FailedInfo
assert_point_list_11 = AssertPointList(
    TestName="CreateGraphMilimeters_1GraphPart_Edge",
    ExpectedPointList=pt_40,
    ActualPointList=divide_7.Points,
    Tolerance="0.0001")  # -> Result, FailedInfo
assert_list_2 = AssertList(TestName="CreateGraphMilimeters_2GraphParts_AdjacencyList", ExpectedList=txt_11, ActualList=panel_13)  # -> Result, FailedInfo
assert_point_list_12 = AssertPointList(
    TestName="CreateGraphMilimeters_1GraphPart_Vertices",
    ExpectedPointList=pt_38,
    ActualPointList=deconstruct_graph_3.Vertices,
    Tolerance="0.0001")  # -> Result, FailedInfo
assert_14 = Assert(TestNames="CreateGraphMilimeters_1GraphPart_GraphArray", Expected=txt_7, Actual=panel_14)  # -> Result, FailedInfo
assert_list_3 = AssertList(TestName="CreateGraphMilimeters_1GraphPart_AdjacencyList", ExpectedList=txt_10, ActualList=panel_11)  # -> Result, FailedInfo
assert_15 = Assert(TestNames="CreateGraphMilimeters_2GraphParts_String", Expected=txt_9, Actual=create_graph_4)  # -> Result, FailedInfo
panel_19 = Panel(deconstruct_graph_6.GraphArray)
assert_list_4 = AssertList(TestName="CreateGraphMilimeters_1GraphPartUndirected_GraphArray", ExpectedList=txt_12, ActualList=panel_16)  # -> Result, FailedInfo
assert_point_list_13 = AssertPointList(
    TestName="CreateGraphMilimeters_1GraphPartUndirected_Edge",
    ExpectedPointList=pt_42,
    ActualPointList=divide_6.Points,
    Tolerance="0.0001")  # -> Result, FailedInfo
assert_point_list_14 = AssertPointList(
    TestName="CreateGraphMilimeters_1GraphPartUndirected_Vertices",
    ExpectedPointList=pt_39,
    ActualPointList=deconstruct_graph_2.Vertices,
    Tolerance="0.0001")  # -> Result, FailedInfo
assert_list_5 = AssertList(TestName="CreateGraphMilimeters_1GraphPartUndirected_AdjacencyList", ExpectedList=txt_14, ActualList=panel_12)  # -> Result, FailedInfo
txt_15 = Text(["0;1", "0;2", "1;2"])
assert_16 = Assert(TestNames="CreateGraphMilimeters_2SeparateGraphParts_String", Expected=txt_13, Actual=create_graph_5)  # -> Result, FailedInfo
txt_16 = Text(["1;2;", "2;", ""])
pt_43 = Point([Point(0, 0, 0), Point(10, 0, 0), Point(5, 5, 0)])
panel_20 = Panel(deconstruct_graph_5.GraphArray)
pt_44 = Point([Point(0, 0, 0), Point(1, 0, 0), Point(2, 0, 0), Point(3, 0, 0), Point(4, 0, 0), Point(5, 0, 0), Point(6, 0, 0), Point(7, 0, 0), Point(8, 0, 0), Point(9, 0, 0)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])
txt_17 = Text(["0;1", "2;3"])
txt_18 = Text(["1;", "", "3;", ""])
pt_45 = Point([Point(0, 0, 0), Point(10, 0, 0), Point(0, 5, 0), Point(10, 5, 0)])
pt_46 = Point([Point(0, 0, 0), Point(1, 0, 0), Point(2, 0, 0), Point(3, 0, 0), Point(4, 0, 0), Point(5, 0, 0), Point(6, 0, 0), Point(7, 0, 0), Point(8, 0, 0), Point(9, 0, 0), Point(10, 0, 0), Point(0, 5, 0), Point(1, 5, 0), Point(2, 5, 0), Point(3, 5, 0), Point(4, 5, 0), Point(5, 5, 0), Point(6, 5, 0), Point(7, 5, 0), Point(8, 5, 0), Point(9, 5, 0), Point(10, 5, 0)])
txt_19 = Text("""Graph
Vertices: 3
Edges: 3""")
assert_point_list_15 = AssertPointList(
    TestName="CreateGraphMilimeters_Triangle_Vertices",
    ExpectedPointList=pt_43,
    ActualPointList=deconstruct_graph_6.Vertices,
    Tolerance="0.0001")  # -> Result, FailedInfo
assert_list_6 = AssertList(TestName="CreateGraphMilimeters_Triangle_GraphArray", ExpectedList=txt_15, ActualList=panel_19)  # -> Result, FailedInfo
assert_point_list_16 = AssertPointList(
    TestName="CreateGraphMilimeters_Triangle_Edge",
    ExpectedPointList=pt_44,
    ActualPointList=divide_9.Points,
    Tolerance="0.0001")  # -> Result, FailedInfo
assert_list_7 = AssertList(TestName="CreateGraphMilimeters_Triangle_AdjacencyList", ExpectedList=txt_16, ActualList=panel_18)  # -> Result, FailedInfo
assert_list_8 = AssertList(TestName="CreateGraphMilimeters_2SeparateGraphParts_GraphArray", ExpectedList=txt_17, ActualList=panel_20)  # -> Result, FailedInfo
assert_point_list_17 = AssertPointList(
    TestName="CreateGraphMilimeters_2SeparateGraphParts_Edge",
    ExpectedPointList=pt_46,
    ActualPointList=divide_8.Points,
    Tolerance="0.0001")  # -> Result, FailedInfo
assert_point_list_18 = AssertPointList(
    TestName="CreateGraphMilimeters_2SeparateGraphParts_Vertices",
    ExpectedPointList=pt_45,
    ActualPointList=deconstruct_graph_5.Vertices,
    Tolerance="0.0001")  # -> Result, FailedInfo
assert_list_9 = AssertList(TestName="CreateGraphMilimeters_2SeparateGraphParts_AdjacencyList", ExpectedList=txt_18, ActualList=panel_17)  # -> Result, FailedInfo
assert_17 = Assert(TestNames="CreateGraphMilimeters_Triangle_String", Expected=txt_19, Actual=create_graph_6)  # -> Result, FailedInfo
entwine_4 = Entwine(
    Branch00=assert_13.Result,
    Branch01=assert_list_4.Result,
    Branch02=assert_point_list_14.Result,
    Branch03=assert_point_list_13.Result,
    Branch04=assert_list_5.Result,
    FlattenInputs=True)  # -> flatten(Result)
entwine_5 = Entwine(
    Branch00=assert_15.Result,
    Branch01=assert_list.Result,
    Branch02=assert_point_list_10.Result,
    Branch03=assert_point_list_9.Result,
    Branch04=assert_list_2.Result,
    FlattenInputs=True)  # -> flatten(Result)
entwine_6 = Entwine(
    Branch00=assert_12.Result,
    Branch01=assert_14.Result,
    Branch02=assert_point_list_12.Result,
    Branch03=assert_point_list_11.Result,
    Branch04=assert_list_3.Result,
    FlattenInputs=True)  # -> flatten(Result)
entwine_7 = Entwine(
    Branch00=assert_16.Result,
    Branch01=assert_list_8.Result,
    Branch02=assert_point_list_18.Result,
    Branch03=assert_point_list_17.Result,
    Branch04=assert_list_9.Result,
    FlattenInputs=True)  # -> flatten(Result)
entwine_8 = Entwine(
    Branch00=assert_17.Result,
    Branch01=assert_list_6.Result,
    Branch02=assert_point_list_15.Result,
    Branch03=assert_point_list_16.Result,
    Branch04=assert_list_7.Result,
    FlattenInputs=True)  # -> flatten(Result)
entwine_9 = Entwine(Branch00=entwine_6, Branch01=entwine_4, Branch02=entwine_7, Branch03=entwine_5, Branch04=entwine_8, FlattenInputs=True)  # -> flatten(Result)

# ----
# Mesh To Graph
pt_47 = Point(Point(10, 10, 0))
pt_48 = Point(Point(0, 10, 0))
pt_49 = Point(Point(0, 0, 0))
pt_50 = Point(Point(10, 0, 0))
face = MeshFace({A=0, B=1, C=2, D=3})
pt_51 = Point(Point(10, 10, 0))
pt_52 = Point(Point(0, 0, 0))
pt_53 = Point(Point(10, 0, 0))
face_2 = MeshFace({A=0, B=2, C=1, D=1})
pt_54 = Point(Point(10, 10, 0))
pt_55 = Point(Point(0, 10, 0))
pt_56 = Point(Point(0, 0, 0))
pt_57 = Point(Point(10, 0, 0))
face_3 = MeshFace({A=0, B=2, C=1, D=1})
face_4 = MeshFace({A=0, B=3, C=2, D=2})
conmesh = ConstructMesh(Vertices=[pt_49, pt_50, pt_47, pt_48], Faces=face)
conmesh_2 = ConstructMesh(Vertices=[pt_52, pt_53, pt_51], Faces=face_2)
pt_58 = Point([Point(7.608514279, 2.629216732, 0), Point(-3.344938733, 10.66174894, 0), Point(8.33874448, 21.90729403, 0), Point(19.29219749, 20.59287967, 0), Point(30.6107656, 8.836173438, 0), Point(29.07728218, 1.38782539, 0), Point(17.39359897, -8.762374401, 0), Point(2.423879854, -8.10516722, 0)])
conmesh_3 = ConstructMesh(Vertices=[pt_56, pt_57, pt_54, pt_55], Faces=[face_3, face_4])
number_slider_9 = Slider(5, range=0..110)
mesh_to_graph = MeshToGraph(Mesh=conmesh)
nurbs_5 = NurbsCurve(Vertices=pt_58, Degree=3, Periodic=True)  # -> Curve, Length, Domain
mesh_to_graph_2 = MeshToGraph(Mesh=conmesh_2)
mesh_to_graph_3 = MeshToGraph(Mesh=conmesh_3)
boundary = BoundarySurfaces(Edges=nurbs_5.Curve)
deconstruct_graph_7 = DeconstructGraph(Graph=mesh_to_graph)  # -> GraphArray, Vertices, Edges, AdjacencyList
crv_11 = Curve(deconstruct_graph_7.Edges)
deconstruct_graph_8 = DeconstructGraph(Graph=mesh_to_graph_2)  # -> GraphArray, Vertices, Edges, AdjacencyList
panel_21 = Panel(deconstruct_graph_7.AdjacencyList)
crv_12 = Curve(deconstruct_graph_8.Edges)
panel_22 = Panel(deconstruct_graph_8.AdjacencyList)
deconstruct_graph_9 = DeconstructGraph(Graph=mesh_to_graph_3)  # -> GraphArray, Vertices, Edges, AdjacencyList
crv_13 = Curve(deconstruct_graph_9.Edges)
divide_10 = DivideCurve(Curve=crv_11, Count=10, Kinks=False)  # -> flatten(Points), Tangents, Parameters
mesh_uv = MeshSurface(Surface=boundary, UCount=number_slider_9, VCount=number_slider_9, Overhang=True, Equalize=False)
panel_23 = Panel(deconstruct_graph_9.AdjacencyList)
divide_11 = DivideCurve(Curve=crv_12, Count=10, Kinks=False)  # -> flatten(Points), Tangents, Parameters
txt_20 = Text("""Graph
Vertices: 4
Edges: 8""")
panel_24 = Panel(deconstruct_graph_7.GraphArray)
txt_21 = Text(["0;1", "1;0", "0;3", "3;0", "1;2", "2;1", "2;3", "3;2"])
divide_12 = DivideCurve(Curve=crv_13, Count=10, Kinks=False)  # -> flatten(Points), Tangents, Parameters
txt_22 = Text(["1;3;", "0;2;", "1;3;", "0;2;"])
txt_23 = Text("""Graph
Vertices: 3
Edges: 6""")
pt_59 = Point([Point(0, 0, 0), Point(10, 0, 0), Point(10, 10, 0), Point(0, 10, 0)])
panel_25 = Panel(deconstruct_graph_8.GraphArray)
txt_24 = Text(["0;1", "1;0", "0;2", "2;0", "1;2", "2;1"])
pt_60 = Point([Point(0, 0, 0), Point(1, 0, 0), Point(2, 0, 0), Point(3, 0, 0), Point(4, 0, 0), Point(5, 0, 0)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])
txt_25 = Text(["1;2;", "0;2;", "0;1;"])
pt_61 = Point([Point(0, 0, 0), Point(10, 0, 0), Point(10, 10, 0)])
txt_26 = Text("""Graph
Vertices: 4
Edges: 10""")
panel_26 = Panel(deconstruct_graph_9.GraphArray)
txt_27 = Text(["0;1", "1;0", "0;2", "2;0", "0;3", "3;0", "1;2", "2;1", "2;3", "3;2"])
pt_62 = Point([Point(0, 0, 0), Point(1, 0, 0), Point(2, 0, 0), Point(3, 0, 0), Point(4, 0, 0), Point(5, 0, 0)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])
mesh_to_graph_4 = MeshToGraph(Mesh=mesh_uv)
deconstruct_graph_10 = DeconstructGraph(Graph=mesh_to_graph_4)  # -> GraphArray, Vertices, Edges, AdjacencyList
crv_14 = Curve(deconstruct_graph_10.Edges)
txt_28 = Text(["1;2;3;", "0;2;", "0;1;3;", "0;2;"])
assert_18 = Assert(TestNames="CreateGraphMilimeters_1FaceQuad_String", Expected=txt_20, Actual=mesh_to_graph)  # -> Result, FailedInfo
panel_27 = Panel(deconstruct_graph_10.AdjacencyList)
pt_63 = Point([Point(0, 0, 0), Point(10, 0, 0), Point(10, 10, 0), Point(0, 10, 0)])
pt_64 = Point([Point(0, 0, 0), Point(1, 0, 0), Point(2, 0, 0), Point(3, 0, 0), Point(4, 0, 0), Point(5, 0, 0)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])
assert_list_10 = AssertList(TestName="CreateGraphMilimeters_1FaceQuad_GraphArray", ExpectedList=txt_21, ActualList=panel_24)  # -> Result, FailedInfo
assert_19 = Assert(TestNames="CreateGraphMilimeters_1FaceTri_String", Expected=txt_23, Actual=mesh_to_graph_2)  # -> Result, FailedInfo
assert_point_list_19 = AssertPointList(
    TestName="CreateGraphMilimeters_1FaceQuad_Edge",
    ExpectedPointList=pt_60,
    ActualPointList=divide_10.Points,
    Tolerance="0.0001")  # -> Result, FailedInfo
assert_point_list_20 = AssertPointList(
    TestName="CreateGraphMilimeters_1FaceQuad_Vertices",
    ExpectedPointList=pt_59,
    ActualPointList=deconstruct_graph_7.Vertices,
    Tolerance="0.0001")  # -> Result, FailedInfo
assert_list_11 = AssertList(TestName="CreateGraphMilimeters_1FaceQuad_AdjacencyList", ExpectedList=txt_22, ActualList=panel_21)  # -> Result, FailedInfo
divide_13 = DivideCurve(Curve=crv_14, Count=10, Kinks=False)  # -> flatten(Points), Tangents, Parameters
assert_list_12 = AssertList(TestName="CreateGraphMilimeters_1FaceTri_GraphArray", ExpectedList=txt_24, ActualList=panel_25)  # -> Result, FailedInfo
assert_point_list_21 = AssertPointList(
    TestName="CreateGraphMilimeters_1FaceTri_Edge",
    ExpectedPointList=pt_62,
    ActualPointList=divide_11.Points,
    Tolerance="0.0001")  # -> Result, FailedInfo
assert_point_list_22 = AssertPointList(
    TestName="CreateGraphMilimeters_1FaceTri_Vertices",
    ExpectedPointList=pt_61,
    ActualPointList=deconstruct_graph_8.Vertices,
    Tolerance="0.0001")  # -> Result, FailedInfo
assert_list_13 = AssertList(TestName="CreateGraphMilimeters_1FaceTri_AdjacencyList", ExpectedList=txt_25, ActualList=panel_22)  # -> Result, FailedInfo
assert_20 = Assert(TestNames="CreateGraphMilimeters_2FaceTri_String", Expected=txt_26, Actual=mesh_to_graph_3)  # -> Result, FailedInfo
assert_list_14 = AssertList(TestName="CreateGraphMilimeters_2FaceTri_GraphArray", ExpectedList=txt_27, ActualList=panel_26)  # -> Result, FailedInfo
assert_point_list_23 = AssertPointList(
    TestName="CreateGraphMilimeters_2FaceTri_Edge",
    ExpectedPointList=pt_64,
    ActualPointList=divide_12.Points,
    Tolerance="0.0001")  # -> Result, FailedInfo
assert_point_list_24 = AssertPointList(
    TestName="CreateGraphMilimeters_2FaceTri_Vertices",
    ExpectedPointList=pt_63,
    ActualPointList=deconstruct_graph_9.Vertices,
    Tolerance="0.0001")  # -> Result, FailedInfo
assert_list_15 = AssertList(TestName="CreateGraphMilimeters_2FaceTri_AdjacencyList", ExpectedList=txt_28, ActualList=panel_23)  # -> Result, FailedInfo
txt_29 = Text("""Graph
Vertices: 34
Edges: 112""")
panel_28 = Panel(deconstruct_graph_10.GraphArray)
txt_30 = Text(["0;1", "1;0", "0;6", "6;0", "1;2", "2;1", "1;7", "7;1", "2;3", "3;2"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])
pt_65 = Point([Point(0.008278349409, 21.76928052, 0), Point(0.008278349409, 15.64673843, 0), Point(0.008278349409, 9.524196334, 0), Point(0.008278349409, 3.401654238, 0), Point(0.008278349409, -2.720887857, 0), Point(0.008278349409, -8.843429953, 0)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])
txt_31 = Text(["1;6;", "0;2;7;", "1;3;8;", "2;4;9;", "3;5;10;", "4;11;", "0;7;12;", "1;6;8;13;", "2;7;9;14;", "3;8;10;15;", "4;9;11;16;", "5;10;17;", "6;13;18;", "7;12;14;19;", "8;13;15;20;", "9;14;16;21;", "10;15;17;22;", "11;16;23;", "12;19;24;", "13;18;20;25;", "14;19;21;26;", "15;20;22;27;", "16;21;23;28;", "17;22;29;", "18;25;", "19;24;26;30;", "20;25;27;31;", "21;26;28;32;", "22;27;29;33;", "23;28;", "25;31;", "26;30;32;", "27;31;33;", "28;32;"])
pt_66 = Point([Point(0.008278349409, 21.76928052, 0), Point(0.008278349409, 21.15702632, 0), Point(0.008278349409, 20.54477211, 0), Point(0.008278349409, 19.9325179, 0), Point(0.008278349409, 19.32026369, 0), Point(0.008278349409, 18.70800948, 0)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])
assert_21 = Assert(TestNames="CreateGraphMilimeters_SurfaceToMesh_String", Expected=txt_29, Actual=mesh_to_graph_4)  # -> Result, FailedInfo
assert_list_16 = AssertList(TestName="CreateGraphMilimeters_SurfaceToMesh_GraphArray", ExpectedList=txt_30, ActualList=panel_28)  # -> Result, FailedInfo
assert_point_list_25 = AssertPointList(
    TestName="CreateGraphMilimeters_SurfaceToMesh_Edge",
    ExpectedPointList=pt_66,
    ActualPointList=divide_13.Points,
    Tolerance="0.0001")  # -> Result, FailedInfo
assert_point_list_26 = AssertPointList(
    TestName="CreateGraphMilimeters_SurfaceToMesh_Vertices",
    ExpectedPointList=pt_65,
    ActualPointList=deconstruct_graph_10.Vertices,
    Tolerance="0.0001")  # -> Result, FailedInfo
assert_list_17 = AssertList(TestName="CreateGraphMilimeters_SurfaceToMesh_AdjacencyList", ExpectedList=txt_31, ActualList=panel_27)  # -> Result, FailedInfo
entwine_10 = Entwine(
    Branch00=assert_18.Result,
    Branch01=assert_list_10.Result,
    Branch02=assert_point_list_20.Result,
    Branch03=assert_point_list_19.Result,
    Branch04=assert_list_11.Result,
    FlattenInputs=True)  # -> flatten(Result)
entwine_11 = Entwine(
    Branch00=assert_19.Result,
    Branch01=assert_list_12.Result,
    Branch02=assert_point_list_22.Result,
    Branch03=assert_point_list_21.Result,
    Branch04=assert_list_13.Result,
    FlattenInputs=True)  # -> flatten(Result)
entwine_12 = Entwine(
    Branch00=assert_20.Result,
    Branch01=assert_list_14.Result,
    Branch02=assert_point_list_24.Result,
    Branch03=assert_point_list_23.Result,
    Branch04=assert_list_15.Result,
    FlattenInputs=True)  # -> flatten(Result)
entwine_13 = Entwine(
    Branch00=assert_21.Result,
    Branch01=assert_list_16.Result,
    Branch02=assert_point_list_26.Result,
    Branch03=assert_point_list_25.Result,
    Branch04=assert_list_17.Result,
    FlattenInputs=True)  # -> flatten(Result)
entwine_14 = Entwine(Branch00=entwine_10, Branch01=entwine_11, Branch02=entwine_12, Branch03=entwine_13, FlattenInputs=True)  # -> flatten(Result)

# ----
# Graph To Report Part
number_slider_10 = Slider(10, range=0..10)
panel_29 = Panel("GraphToReportPartMilimeters_1GraphPartDirectionTrueShowWeightsTrue_ReportPart")
panel_30 = Panel("GraphToReportPartMilimeters_1GraphPartDirectionFalseShowWeightsTrue_ReportPart")
panel_31 = Panel("GraphToReportPartMilimeters_1GraphPartDirectionFalseShowWeightsFalse_ReportPart")
pt_67 = ConstructPoint(XCoordinate=0, YCoordinate=0, ZCoordinate=0)
pt_68 = ConstructPoint(XCoordinate=number_slider_10, YCoordinate=0, ZCoordinate=0)
pt_69 = ConstructPoint(XCoordinate=0, YCoordinate=0, ZCoordinate=0)
pt_70 = ConstructPoint(XCoordinate=Slider(10, range=0..10), YCoordinate=0, ZCoordinate=0)
pt_71 = ConstructPoint(XCoordinate=0, YCoordinate=0, ZCoordinate=0)
pt_72 = ConstructPoint(XCoordinate=Slider(10, range=0..10), YCoordinate=0, ZCoordinate=0)
panel_32 = Panel("GraphToReportPartMilimeters_1GraphPartUndirectedDirectionTrueShowWeightsTrue_ReportPart")
panel_33 = Panel("GraphToReportPartMilimeters_1GraphPartDirectionFalseShowWeightsTrue_TextFormat")
pt_73 = ConstructPoint(XCoordinate=0, YCoordinate=0, ZCoordinate=0)
pt_74 = ConstructPoint(XCoordinate=Slider(10, range=0..10), YCoordinate=0, ZCoordinate=0)
panel_34 = Panel("GraphToReportPartMilimeters_TriangleDirectionTrueShowWeightsTrue_ReportPart")
panel_35 = Panel("GraphToReportPartMilimeters_TriangleDirectionFalseShowWeightsTrue_ReportPart")
pt_75 = ConstructPoint(XCoordinate=0, YCoordinate=0, ZCoordinate=0)
pt_76 = ConstructPoint(XCoordinate=Slider(10, range=0..10), YCoordinate=0, ZCoordinate=0)
two_points_to_graph_part_16 = TwoPointsToGraphPart(PointA=pt_67, PointB=pt_68, IsDirected=Toggle(True))
two_points_to_graph_part_17 = TwoPointsToGraphPart(PointA=pt_69, PointB=pt_70, IsDirected=Toggle(True))
two_points_to_graph_part_18 = TwoPointsToGraphPart(PointA=pt_71, PointB=pt_72, IsDirected=Toggle(True))
toggle_6 = BooleanToggle(True)
toggle_7 = BooleanToggle(True)
pt_77 = ConstructPoint(XCoordinate=0, YCoordinate=0, ZCoordinate=0)
pt_78 = ConstructPoint(XCoordinate=Slider(10, range=0..10), YCoordinate=0, ZCoordinate=0)
pt_79 = ConstructPoint(XCoordinate=0, YCoordinate=0, ZCoordinate=0)
pt_80 = ConstructPoint(XCoordinate=Slider(5, range=0..10), YCoordinate=Slider(5, range=0..10), ZCoordinate=0)
pt_81 = ConstructPoint(XCoordinate=0, YCoordinate=0, ZCoordinate=0)
pt_82 = ConstructPoint(XCoordinate=Slider(10, range=0..10), YCoordinate=0, ZCoordinate=0)
pt_83 = ConstructPoint(XCoordinate=0, YCoordinate=0, ZCoordinate=0)
pt_84 = ConstructPoint(XCoordinate=Slider(5, range=0..10), YCoordinate=Slider(5, range=0..10), ZCoordinate=0)
two_points_to_graph_part_19 = TwoPointsToGraphPart(PointA=pt_73, PointB=pt_74, IsDirected=Toggle(True))
two_points_to_graph_part_20 = TwoPointsToGraphPart(PointA=pt_75, PointB=pt_76, IsDirected=Toggle(False))
two_points_to_graph_part_21 = TwoPointsToGraphPart(PointA=pt_79, PointB=pt_80, IsDirected=toggle_6)
two_points_to_graph_part_22 = TwoPointsToGraphPart(PointA=pt_78, PointB=pt_80, IsDirected=toggle_6)
two_points_to_graph_part_23 = TwoPointsToGraphPart(PointA=pt_77, PointB=pt_78, IsDirected=toggle_6)
two_points_to_graph_part_24 = TwoPointsToGraphPart(PointA=pt_83, PointB=pt_84, IsDirected=toggle_7)
two_points_to_graph_part_25 = TwoPointsToGraphPart(PointA=pt_82, PointB=pt_84, IsDirected=toggle_7)
two_points_to_graph_part_26 = TwoPointsToGraphPart(PointA=pt_81, PointB=pt_82, IsDirected=toggle_7)
create_graph_7 = CreateGraph(GraphParts=two_points_to_graph_part_16, Tolerance=0.0001)
create_graph_8 = CreateGraph(GraphParts=two_points_to_graph_part_17, Tolerance=0.0001)
create_graph_9 = CreateGraph(GraphParts=two_points_to_graph_part_18, Tolerance=0.0001)
create_graph_10 = CreateGraph(GraphParts=two_points_to_graph_part_19, Tolerance=0.0001)
create_graph_11 = CreateGraph(GraphParts=two_points_to_graph_part_20, Tolerance=0.0001)
graph_to_report_part = GraphToReportPart(Graph=create_graph_8, Direction=Toggle(False), ShowWeights=Toggle(True), TextFormat="{0:0.00}")
graph_to_report_part_2 = GraphToReportPart(Graph=create_graph_9, Direction=Toggle(False), ShowWeights=Toggle(False), TextFormat="{0:0.00}")
graph_to_report_part_3 = GraphToReportPart(Graph=create_graph_7, Direction=Toggle(True), ShowWeights=Toggle(True), TextFormat="{0:0.00}")
create_graph_12 = CreateGraph(GraphParts=[two_points_to_graph_part_23, two_points_to_graph_part_21, two_points_to_graph_part_22], Tolerance=0.0001)
create_graph_13 = CreateGraph(GraphParts=[two_points_to_graph_part_26, two_points_to_graph_part_24, two_points_to_graph_part_25], Tolerance=0.0001)
graph_to_report_part_4 = GraphToReportPart(Graph=create_graph_10, Direction=Toggle(False), ShowWeights=Toggle(True), TextFormat="{0:0.0000}")
txt_32 = Text("""```mermaid
graph LR
0--10.00-->1;
```""")
txt_33 = Text("""```mermaid
graph TD
0--10.00-->1;
```""")
graph_to_report_part_5 = GraphToReportPart(Graph=create_graph_11, Direction=Toggle(True), ShowWeights=Toggle(True), TextFormat="{0:0.00}")
txt_34 = Text("""```mermaid
graph TD
0-->1;
```""")
txt_35 = Text("""```mermaid
graph TD
0--10.0000-->1;
```""")
graph_to_report_part_6 = GraphToReportPart(Graph=create_graph_12, Direction=Toggle(True), ShowWeights=Toggle(True), TextFormat="{0:0.00}")
txt_36 = Text("""```mermaid
graph LR
0--10.00-->1;
1--10.00-->0;
```""")
graph_to_report_part_7 = GraphToReportPart(Graph=create_graph_13, Direction=Toggle(False), ShowWeights=Toggle(True), TextFormat="{0:0.00}")
assert_22 = Assert(TestNames=panel_29, Expected=txt_32, Actual=graph_to_report_part_3)  # -> Result, FailedInfo
assert_23 = Assert(TestNames=panel_30, Expected=txt_33, Actual=graph_to_report_part)  # -> Result, FailedInfo
assert_24 = Assert(TestNames=panel_31, Expected=txt_34, Actual=graph_to_report_part_2)  # -> Result, FailedInfo
txt_37 = Text("""```mermaid
graph LR
0--10.00-->1;
0--7.07-->2;
1--7.07-->2;
```""")
txt_38 = Text("""```mermaid
graph TD
0--10.00-->1;
0--7.07-->2;
1--7.07-->2;
```""")
assert_25 = Assert(TestNames=panel_33, Expected=txt_35, Actual=graph_to_report_part_4)  # -> Result, FailedInfo
assert_26 = Assert(TestNames=panel_32, Expected=txt_36, Actual=graph_to_report_part_5)  # -> Result, FailedInfo
assert_27 = Assert(TestNames=panel_34, Expected=txt_37, Actual=graph_to_report_part_6)  # -> Result, FailedInfo
assert_28 = Assert(TestNames=panel_35, Expected=txt_38, Actual=graph_to_report_part_7)  # -> Result, FailedInfo
entwine_15 = Entwine(
    Branch00=assert_22.Result,
    Branch01=assert_23.Result,
    Branch02=assert_24.Result,
    Branch03=assert_25.Result,
    Branch04=assert_26.Result,
    Branch05=assert_27.Result,
    Branch06=assert_28.Result,
    FlattenInputs=True)  # -> flatten(Result)

pt_85 = Point([Point(7.608514279, 2.629216732, 0), Point(-3.344938733, 10.66174894, 0), Point(8.33874448, 21.90729403, 0), Point(19.29219749, 20.59287967, 0), Point(30.6107656, 8.836173438, 0), Point(29.07728218, 1.38782539, 0), Point(17.39359897, -8.762374401, 0), Point(2.423879854, -8.10516722, 0)])
number_slider_11 = Slider(5, range=0..110)
nurbs_6 = NurbsCurve(Vertices=pt_85, Degree=3, Periodic=True)  # -> Curve, Length, Domain
panel_36 = Panel("GraphToReportPartMilimeters_Mesh_TooManyEdgesException")
boundary_2 = BoundarySurfaces(Edges=nurbs_6.Curve)
mesh_uv_2 = MeshSurface(Surface=boundary_2, UCount=number_slider_11, VCount=number_slider_11, Overhang=True, Equalize=False)
mesh_to_graph_5 = MeshToGraph(Mesh=mesh_uv_2)
graph_to_report_part_8 = GraphToReportPart(Graph=mesh_to_graph_5, Direction=True, ShowWeights=True, TextFormat="{0:0.00}")

# ----
# Get Closest Vertex
pt_86 = Point([Point(7.608514279, 2.629216732, 0), Point(-3.344938733, 10.66174894, 0), Point(8.33874448, 21.90729403, 0), Point(19.29219749, 20.59287967, 0), Point(30.6107656, 8.836173438, 0), Point(29.07728218, 1.38782539, 0), Point(17.39359897, -8.762374401, 0), Point(2.423879854, -8.10516722, 0)])
pt_87 = Point([Point(7.608514279, 2.629216732, 0), Point(-3.344938733, 10.66174894, 0), Point(8.33874448, 21.90729403, 0), Point(19.29219749, 20.59287967, 0), Point(30.6107656, 8.836173438, 0), Point(29.07728218, 1.38782539, 0), Point(17.39359897, -8.762374401, 0), Point(2.423879854, -8.10516722, 0)])
number_slider_12 = Slider(5, range=0..110)
number_slider_13 = Slider(5, range=0..110)
nurbs_7 = NurbsCurve(Vertices=pt_86, Degree=3, Periodic=True)  # -> Curve, Length, Domain
nurbs_8 = NurbsCurve(Vertices=pt_87, Degree=3, Periodic=True)  # -> Curve, Length, Domain
boundary_3 = BoundarySurfaces(Edges=nurbs_7.Curve)
boundary_4 = BoundarySurfaces(Edges=nurbs_8.Curve)
mesh_uv_3 = MeshSurface(Surface=boundary_3, UCount=number_slider_12, VCount=number_slider_12, Overhang=True, Equalize=False)
msphere = MeshSphere(Base=PlaneXY(0, 0, 0), Radius=10, UCount=10, VCount=20)
mesh_uv_4 = MeshSurface(Surface=boundary_4, UCount=number_slider_13, VCount=number_slider_13, Overhang=True, Equalize=False)
mesh_to_graph_6 = MeshToGraph(Mesh=mesh_uv_3)
mesh_to_graph_7 = MeshToGraph(Mesh=mesh_uv_4)
mesh_to_graph_8 = MeshToGraph(Mesh=msphere)
pt_88 = Point(Point(39.87977959, 18.67332239, 0))
pt_89 = Point(Point(13.21999551, 8.355425302, 0))
pt_90 = Point(Point(11.47869486, 6.849099476, 15.28077532))
deconstruct_graph_11 = DeconstructGraph(Graph=mesh_to_graph_6)  # -> GraphArray, Vertices, Edges, AdjacencyList
deconstruct_graph_12 = DeconstructGraph(Graph=mesh_to_graph_7)  # -> GraphArray, Vertices, Edges, AdjacencyList
get_closest_vertex = GetClosestVertex(Graph=mesh_to_graph_6, Point=pt_88)
deconstruct_graph_13 = DeconstructGraph(Graph=mesh_to_graph_8)  # -> GraphArray, Vertices, Edges, AdjacencyList
get_closest_vertex_2 = GetClosestVertex(Graph=mesh_to_graph_7, Point=pt_89)
get_closest_vertex_3 = GetClosestVertex(Graph=mesh_to_graph_8, Point=pt_90)
panel_37 = Panel(get_closest_vertex)
panel_38 = Panel(get_closest_vertex_2)
item = ListItem(List=deconstruct_graph_11.Vertices, Index=get_closest_vertex, Wrap=True)
txt_39 = Text("30")
item_2 = ListItem(List=deconstruct_graph_12.Vertices, Index=get_closest_vertex_2, Wrap=True)
txt_40 = Text("14")
panel_39 = Panel(get_closest_vertex_3)
item_3 = ListItem(List=deconstruct_graph_13.Vertices, Index=get_closest_vertex_3, Wrap=True)
txt_41 = Text("143")
assert_29 = Assert(TestNames="GetClosestVertexMilimeters_XYMeshOutside_Index", Expected=txt_39, Actual=panel_37)  # -> Result, FailedInfo
assert_30 = Assert(TestNames="GetClosestVertexMilimeters_XYMesh_Index", Expected=txt_40, Actual=panel_38)  # -> Result, FailedInfo
assert_31 = Assert(TestNames="GetClosestVertexMilimeters_3dMesh_Index", Expected=txt_41, Actual=panel_39)  # -> Result, FailedInfo
entwine_16 = Entwine(Branch00=assert_30.Result, Branch01=assert_29.Result, Branch02=assert_31.Result, FlattenInputs=True)  # -> flatten(Result)

# ----
# Get Graph Degree
number_slider_14 = Slider(10, range=0..10)
pt_91 = Point(Point(10, 10, 0))
pt_92 = Point(Point(0, 10, 0))
pt_93 = Point(Point(0, 0, 0))
pt_94 = Point(Point(10, 0, 0))
face_5 = MeshFace({A=0, B=2, C=1, D=1})
face_6 = MeshFace({A=0, B=3, C=2, D=2})
toggle_8 = BooleanToggle(True)
pt_95 = ConstructPoint(XCoordinate=0, YCoordinate=0, ZCoordinate=0)
pt_96 = ConstructPoint(XCoordinate=Slider(10, range=0..10), YCoordinate=0, ZCoordinate=0)
pt_97 = ConstructPoint(XCoordinate=0, YCoordinate=0, ZCoordinate=0)
pt_98 = ConstructPoint(XCoordinate=number_slider_14, YCoordinate=0, ZCoordinate=0)
pt_99 = ConstructPoint(XCoordinate=0, YCoordinate=0, ZCoordinate=0)
pt_100 = ConstructPoint(XCoordinate=Slider(10, range=0..10), YCoordinate=0, ZCoordinate=0)
pt_101 = ConstructPoint(XCoordinate=0, YCoordinate=0, ZCoordinate=0)
pt_102 = ConstructPoint(XCoordinate=Slider(5, range=0..10), YCoordinate=Slider(5, range=0..10), ZCoordinate=0)
conmesh_4 = ConstructMesh(Vertices=[pt_93, pt_94, pt_91, pt_92], Faces=[face_5, face_6])
two_points_to_graph_part_27 = TwoPointsToGraphPart(PointA=pt_95, PointB=pt_96, IsDirected=Toggle(True))
two_points_to_graph_part_28 = TwoPointsToGraphPart(PointA=pt_97, PointB=pt_98, IsDirected=Toggle(False))
two_points_to_graph_part_29 = TwoPointsToGraphPart(PointA=pt_101, PointB=pt_102, IsDirected=toggle_8)
two_points_to_graph_part_30 = TwoPointsToGraphPart(PointA=pt_100, PointB=pt_102, IsDirected=toggle_8)
two_points_to_graph_part_31 = TwoPointsToGraphPart(PointA=pt_99, PointB=pt_100, IsDirected=toggle_8)
mesh_to_graph_9 = MeshToGraph(Mesh=conmesh_4)
create_graph_14 = CreateGraph(GraphParts=two_points_to_graph_part_27, Tolerance=0.0001)
create_graph_15 = CreateGraph(GraphParts=two_points_to_graph_part_28, Tolerance=0.0001)
create_graph_16 = CreateGraph(GraphParts=[two_points_to_graph_part_31, two_points_to_graph_part_29, two_points_to_graph_part_30], Tolerance=0.0001)
get_graph_degree = GetGraphDegree(Graph=mesh_to_graph_9)
get_graph_degree_2 = GetGraphDegree(Graph=create_graph_14)
get_graph_degree_3 = GetGraphDegree(Graph=create_graph_15)
int = Integer(6)
get_graph_degree_4 = GetGraphDegree(Graph=create_graph_16)
assert_32 = Assert(TestNames="GetGraphDegreeMilimeters_2FaceTriMesh_Degree", Expected=int, Actual=get_graph_degree)  # -> Result, FailedInfo
int_2 = Integer(2)
int_3 = Integer(1)
int_4 = Integer(2)
assert_33 = Assert(TestNames="GetGraphDegreeMilimeters_Triangle_Degree", Expected=int_2, Actual=get_graph_degree_4)  # -> Result, FailedInfo
assert_34 = Assert(TestNames="GetGraphDegreeMilimeters_1GraphPart_Degree", Expected=int_3, Actual=get_graph_degree_2)  # -> Result, FailedInfo
assert_35 = Assert(TestNames="GetGraphDegreeMilimeters_1GraphPartUndirected_Degree", Expected=int_4, Actual=get_graph_degree_3)  # -> Result, FailedInfo
entwine_17 = Entwine(
    Branch00=assert_34.Result,
    Branch01=assert_35.Result,
    Branch02=assert_33.Result,
    Branch03=assert_32.Result,
    FlattenInputs=True)  # -> flatten(Result)

# ----
# Get Vertex Degree
number_slider_15 = Slider(10, range=0..10)
pt_103 = Point(Point(10, 10, 0))
pt_104 = Point(Point(0, 10, 0))
pt_105 = Point(Point(0, 0, 0))
pt_106 = Point(Point(10, 0, 0))
face_7 = MeshFace({A=0, B=2, C=1, D=1})
face_8 = MeshFace({A=0, B=3, C=2, D=2})
pt_107 = ConstructPoint(XCoordinate=0, YCoordinate=0, ZCoordinate=0)
pt_108 = ConstructPoint(XCoordinate=number_slider_15, YCoordinate=0, ZCoordinate=0)
toggle_9 = BooleanToggle(False)
conmesh_5 = ConstructMesh(Vertices=[pt_105, pt_106, pt_103, pt_104], Faces=[face_7, face_8])
pt_109 = ConstructPoint(XCoordinate=0, YCoordinate=0, ZCoordinate=0)
pt_110 = ConstructPoint(XCoordinate=Slider(10, range=0..10), YCoordinate=0, ZCoordinate=0)
pt_111 = ConstructPoint(XCoordinate=0, YCoordinate=0, ZCoordinate=0)
pt_112 = ConstructPoint(XCoordinate=Slider(5, range=0..10), YCoordinate=Slider(5, range=0..10), ZCoordinate=0)
two_points_to_graph_part_32 = TwoPointsToGraphPart(PointA=pt_107, PointB=pt_108, IsDirected=Toggle(True))
mesh_to_graph_10 = MeshToGraph(Mesh=conmesh_5)
two_points_to_graph_part_33 = TwoPointsToGraphPart(PointA=pt_111, PointB=pt_112, IsDirected=toggle_9)
two_points_to_graph_part_34 = TwoPointsToGraphPart(PointA=pt_110, PointB=pt_112, IsDirected=toggle_9)
two_points_to_graph_part_35 = TwoPointsToGraphPart(PointA=pt_109, PointB=pt_110, IsDirected=toggle_9)
create_graph_17 = CreateGraph(GraphParts=two_points_to_graph_part_32, Tolerance=0.0001)
get_vertex_degrees = GetVertexDegrees(Graph=mesh_to_graph_10, Index="0")  # -> Degree, Indegree, Outdegree
create_graph_18 = CreateGraph(GraphParts=[two_points_to_graph_part_35, two_points_to_graph_part_33, two_points_to_graph_part_34], Tolerance=0.0001)
get_vertex_degrees_2 = GetVertexDegrees(Graph=create_graph_17, Index="0")  # -> Degree, Indegree, Outdegree
get_vertex_degrees_3 = GetVertexDegrees(Graph=create_graph_17, Index="1")  # -> Degree, Indegree, Outdegree
get_vertex_degrees_4 = GetVertexDegrees(Graph=create_graph_18, Index="0")  # -> Degree, Indegree, Outdegree
int_5 = Integer([6, 3, 3])
int_6 = Integer([1, 0, 1])
int_7 = Integer([1, 1, 0])
assert_list_18 = AssertList(
    TestName="GetVertexDegreeMilimeters_Mesh_Degrees",
    ExpectedList=int_5,
    ActualList=[get_vertex_degrees.Degree, get_vertex_degrees.Indegree, get_vertex_degrees.Outdegree])  # -> Result, FailedInfo
int_8 = Integer([4, 2, 2])
assert_list_19 = AssertList(
    TestName="GetVertexDegreeMilimeters_1GraphPartVertex0_Degrees",
    ExpectedList=int_6,
    ActualList=[get_vertex_degrees_2.Degree, get_vertex_degrees_2.Indegree, get_vertex_degrees_2.Outdegree])  # -> Result, FailedInfo
assert_list_20 = AssertList(
    TestName="GetVertexDegreeMilimeters_1GraphPartVertex1_Degrees",
    ExpectedList=int_7,
    ActualList=[get_vertex_degrees_3.Degree, get_vertex_degrees_3.Indegree, get_vertex_degrees_3.Outdegree])  # -> Result, FailedInfo
assert_list_21 = AssertList(
    TestName="GetVertexDegreeMilimeters_Triangle_Degrees",
    ExpectedList=int_8,
    ActualList=[get_vertex_degrees_4.Degree, get_vertex_degrees_4.Indegree, get_vertex_degrees_4.Outdegree])  # -> Result, FailedInfo
entwine_18 = Entwine(
    Branch00=assert_list_19.Result,
    Branch01=assert_list_20.Result,
    Branch02=assert_list_18.Result,
    Branch03=assert_list_21.Result,
    FlattenInputs=True)  # -> flatten(Result)

# ----
# BFS Is Graph Connected
number_slider_16 = Slider(50, range=0..100)
cir_2 = Circle(Plane=PlaneXY(0, 0, 0), Radius=number_slider_16)
X = UnitX(Factor=Slider(50, range=0..100))
move = Move(Geometry=cir_2, Motion=X)  # -> Geometry, Transform
toggle_10 = BooleanToggle(False)
pt_113 = Point(Point(10, 0, 0))
pt_114 = Point([Point(11.93097943, 2.333746014, 0), Point(14.26771607, 5.254666817, 0), Point(8.790989568, 7.95651856, 0), Point(6.673321986, 4.524436616, 0), Point(8.430151768, 1.423977564, 0)])
toggle_11 = BooleanToggle(False)
pt_115 = Point([Point(11.93097943, 2.333746014, 0), Point(14.26771607, 5.254666817, 0), Point(8.790989568, 7.95651856, 0), Point(6.673321986, 4.524436616, 0), Point(8.430151768, 1.423977564, 0)])
pt_116 = Point(Point(10, 0, 0))
pt_117 = Point(Point(10, 0, 0))
toggle_12 = BooleanToggle(False)
rdiff = RegionDifference(CurvesA=move.Geometry, CurvesB=cir_2)
pt_118 = Point(Point(10, 0, 0))
rdiff_2 = RegionDifference(CurvesA=cir_2, CurvesB=move.Geometry)
pt_119 = Point(Point(20, 0, 0))
pt_120 = Point(Point(10, 0, 0))
pt_121 = Point(Point(0, 0, 0))
pt_122 = Point(Point(10, 0, 0))
nurbs_9 = NurbsCurve(Vertices=[pt_122, pt_114, pt_113], Degree=3, Periodic=False)  # -> Curve, Length, Domain
pt_123 = Point(Point(0, 0, 0))
nurbs_10 = NurbsCurve(Vertices=[pt_117, pt_115, pt_116], Degree=3, Periodic=False)  # -> Curve, Length, Domain
pt_124 = Point(Point(5, 0, 0))
pt_125 = Point(Point(0, 0, 0))
boundary_5 = BoundarySurfaces(Edges=rdiff)
boundary_6 = BoundarySurfaces(Edges=rdiff_2)
two_points_to_graph_part_36 = TwoPointsToGraphPart(PointA=pt_121, PointB=pt_120, IsDirected=toggle_11)
two_points_to_graph_part_37 = TwoPointsToGraphPart(PointA=pt_119, PointB=pt_118, IsDirected=toggle_11)
cir_3 = Circle(Plane=PlaneXY(0, 0, 0), Radius=Slider(50, range=0..100))
curve_to_graph_part_6 = CurveToGraphPart(Curve=nurbs_9.Curve, IsDirected=toggle_12)
two_points_to_graph_part_38 = TwoPointsToGraphPart(PointA=pt_123, PointB=pt_122, IsDirected=toggle_12)
edges = BrepEdges(Brep=boundary_5)  # -> Naked, Interior, NonManifold
edges_2 = BrepEdges(Brep=boundary_6)  # -> Naked, Interior, NonManifold
curve_to_graph_part_7 = CurveToGraphPart(Curve=nurbs_10.Curve, IsDirected=toggle_10)
two_points_to_graph_part_39 = TwoPointsToGraphPart(PointA=pt_125, PointB=pt_124, IsDirected=toggle_10)
number_slider_17 = Slider(11, range=0..100)
panel_40 = Panel("BFSIsGraphConnecttedMilimeters_TwoPointsWithSeparateCycle_Bool")
item_4 = ListItem(List=edges.Naked, Index=0, Wrap=True)  # -> Item, Item1, Item2
item_5 = ListItem(List=edges_2.Naked, Index=0, Wrap=True)  # -> Item, Item1
boundary_7 = BoundarySurfaces(Edges=cir_3)
number_slider_18 = Slider(11, range=0..100)
create_graph_19 = CreateGraph(GraphParts=[two_points_to_graph_part_36, two_points_to_graph_part_37], Tolerance=0.0001)
join = JoinCurves(Curves=[item_5.Item1, item_4.Item1, item_4.Item], Preserve=False)
create_graph_20 = CreateGraph(GraphParts=[two_points_to_graph_part_38, curve_to_graph_part_6], Tolerance=0.0001)
X_2 = UnitX(Factor=Slider(150, range=0..150))
create_graph_21 = CreateGraph(GraphParts=[two_points_to_graph_part_39, curve_to_graph_part_7], Tolerance=0.0001)
mesh_uv_5 = MeshSurface(Surface=boundary_7, UCount=number_slider_17, VCount=number_slider_17, Overhang=True, Equalize=False)
boundary_8 = BoundarySurfaces(Edges=join)
move_2 = Move(Geometry=mesh_uv_5, Motion=X_2)  # -> Geometry, Transform
bfs_is_graph_connected = BFSIsGraphConnected(Graph=create_graph_19)
mesh_uv_6 = MeshSurface(Surface=boundary_8, UCount=number_slider_18, VCount=number_slider_18, Overhang=True, Equalize=False)
bfs_is_graph_connected_2 = BFSIsGraphConnected(Graph=create_graph_20)
mjoin = MeshJoin(Meshes=[mesh_uv_5, move_2.Geometry])
bfs_is_graph_connected_3 = BFSIsGraphConnected(Graph=create_graph_21)
mesh_to_graph_11 = MeshToGraph(Mesh=mesh_uv_6)
mesh_to_graph_12 = MeshToGraph(Mesh=mjoin)
bool_5 = Boolean(True)
bool_6 = Boolean(True)
bool_7 = Boolean(False)
bfs_is_graph_connected_4 = BFSIsGraphConnected(Graph=mesh_to_graph_11)
assert_36 = Assert(TestNames="BFSIsGraphConnecttedMilimeters_TwoPointsWithBridge_Bool", Expected=bool_5, Actual=bfs_is_graph_connected)  # -> Result, FailedInfo
assert_37 = Assert(TestNames="BFSIsGraphConnecttedMilimeters_TwoPointsWithCycle_Bool", Expected=bool_6, Actual=bfs_is_graph_connected_2)  # -> Result, FailedInfo
bfs_is_graph_connected_5 = BFSIsGraphConnected(Graph=mesh_to_graph_12)
assert_38 = Assert(TestNames=panel_40, Expected=bool_7, Actual=bfs_is_graph_connected_3)  # -> Result, FailedInfo
bool_8 = Boolean(True)
bool_9 = Boolean(False)
panel_41 = Panel(bfs_is_graph_connected_4)
assert_39 = Assert(TestNames="BFSIsGraphConnecttedMilimeters_ConnectedCircles_Bool", Expected=bool_8, Actual=bfs_is_graph_connected_4)  # -> Result, FailedInfo
panel_42 = Panel(bfs_is_graph_connected_5)
assert_40 = Assert(TestNames="BFSIsGraphConnecttedMilimeters_SeparateCircles_Bool", Expected=bool_9, Actual=bfs_is_graph_connected_5)  # -> Result, FailedInfo
entwine_19 = Entwine(
    Branch00=assert_39.Result,
    Branch01=assert_40.Result,
    Branch02=assert_36.Result,
    Branch03=assert_37.Result,
    Branch04=assert_38.Result,
    FlattenInputs=True)  # -> flatten(Result)

number_slider_19 = Slider(5, range=0..10)
pt_126 = ConstructPoint(XCoordinate=0, YCoordinate=0, ZCoordinate=0)
pt_127 = ConstructPoint(XCoordinate=Slider(10, range=0..10), YCoordinate=0, ZCoordinate=0)
pt_128 = ConstructPoint(XCoordinate=0, YCoordinate=0, ZCoordinate=0)
pt_129 = ConstructPoint(XCoordinate=Slider(10, range=0..10), YCoordinate=0, ZCoordinate=0)
pt_130 = ConstructPoint(XCoordinate=0, YCoordinate=0, ZCoordinate=0)
pt_131 = ConstructPoint(XCoordinate=Slider(10, range=0..10), YCoordinate=0, ZCoordinate=0)
two_points_to_graph_part_40 = TwoPointsToGraphPart(PointA=pt_126, PointB=pt_127, IsDirected=Toggle(True))
two_points_to_graph_part_41 = TwoPointsToGraphPart(PointA=pt_128, PointB=pt_129, IsDirected=Toggle(True))
two_points_to_graph_part_42 = TwoPointsToGraphPart(PointA=pt_130, PointB=pt_131, IsDirected=Toggle(True))
toggle_13 = BooleanToggle(True)
panel_43 = Panel("BFSSearchMilimeters_1GraphEdgeUndirectedStart0_PreviousArray")
pt_132 = ConstructPoint(XCoordinate=number_slider_19, YCoordinate=Slider(10, range=0..20), ZCoordinate=0)
pt_133 = ConstructPoint(XCoordinate=Slider(10, range=0..10), YCoordinate=0, ZCoordinate=0)
pt_134 = ConstructPoint(XCoordinate=0, YCoordinate=0, ZCoordinate=0)
pt_135 = ConstructPoint(XCoordinate=0, YCoordinate=0, ZCoordinate=0)
pt_136 = ConstructPoint(XCoordinate=number_slider_19, YCoordinate=Slider(5, range=0..10), ZCoordinate=0)
two_points_to_graph_part_43 = TwoPointsToGraphPart(PointA=pt_136, PointB=pt_132, IsDirected=toggle_13)
two_points_to_graph_part_44 = TwoPointsToGraphPart(PointA=pt_135, PointB=pt_136, IsDirected=toggle_13)
two_points_to_graph_part_45 = TwoPointsToGraphPart(PointA=pt_133, PointB=pt_136, IsDirected=toggle_13)
two_points_to_graph_part_46 = TwoPointsToGraphPart(PointA=pt_134, PointB=pt_133, IsDirected=toggle_13)
create_graph_22 = CreateGraph(GraphParts=two_points_to_graph_part_40, Tolerance=0.0001)
# BFS Search
create_graph_23 = CreateGraph(GraphParts=two_points_to_graph_part_41, Tolerance=0.0001)
create_graph_24 = CreateGraph(GraphParts=two_points_to_graph_part_42, Tolerance=0.0001)
bfs_search_2 = BFSSearch(Graph=create_graph_22, StartVertexIndex="1", KeepSearching=Toggle(False))  # -> Visited, PreviousArray
bfs_search_3 = BFSSearch(Graph=create_graph_23, StartVertexIndex="0", KeepSearching=Toggle(False))  # -> Visited, PreviousArray
bfs_search_4 = BFSSearch(Graph=create_graph_24, StartVertexIndex="0", KeepSearching=Toggle(False))  # -> Visited, PreviousArray
create_graph_25 = CreateGraph(
    GraphParts=[two_points_to_graph_part_46, two_points_to_graph_part_44, two_points_to_graph_part_45, two_points_to_graph_part_43],
    Tolerance=0.0001)
bfs_search_5 = BFSSearch(Graph=create_graph_25, StartVertexIndex=0, KeepSearching=Toggle(False))  # -> Visited, PreviousArray
deconstruct_graph_14 = DeconstructGraph(Graph=create_graph_25)  # -> GraphArray, Vertices, Edges, AdjacencyList
lng_2 = ListLength(List=deconstruct_graph_14.Vertices)
series_2 = Series(Start=0, Step=1, Count=lng_2)
pt_137 = Point(Point(10, 0, 0))
txt_42 = Text(["-1", "0"])
pt_138 = Point([Point(0, 0, 0), Point(10, 0, 0)])
txt_43 = Text(["-1", "0"])
panel_44 = Panel(bfs_search_2.PreviousArray)
pt_139 = Point([Point(0, 0, 0), Point(10, 0, 0)])
txt_44 = Text(["-1", "-1"])
panel_45 = Panel(bfs_search_3.PreviousArray)
panel_46 = Panel(bfs_search_4.PreviousArray)
pt_140 = Point([Point(0, 0, 0), Point(10, 0, 0), Point(5, 5, 0), Point(5, 10, 0)])
assert_list_22 = AssertList(
    TestName="BFSSearchMilimeters_1GraphEdgeDirectedStart0_PreviousArray",
    ExpectedList=txt_43,
    ActualList=bfs_search_3.PreviousArray)  # -> Result, FailedInfo
assert_point_list_27 = AssertPointList(
    TestName="BFSSearchMilimeters_1GraphEdgeDirectedStart0_Visited",
    ExpectedPointList=pt_137,
    ActualPointList=bfs_search_2.Visited,
    Tolerance=Slider(0.0001, range=0..0.0001))  # -> Result, FailedInfo
assert_list_23 = AssertList(TestName=panel_43, ExpectedList=txt_42, ActualList=bfs_search_4.PreviousArray)  # -> Result, FailedInfo
assert_list_24 = AssertList(
    TestName="BFSSearchMilimeters_1GraphEdgeDirectedStart0_PreviousArray",
    ExpectedList=txt_44,
    ActualList=bfs_search_2.PreviousArray)  # -> Result, FailedInfo
txt_45 = Text(["-1", "0", "0", "2"])
tag_2 = TextTag3D(Location=deconstruct_graph_14.Vertices, Text=series_2, Size=1, Justification=7)
assert_point_list_28 = AssertPointList(
    TestName="BFSSearchMilimeters_1GraphEdgeDirectedStart0_Visited",
    ExpectedPointList=pt_138,
    ActualPointList=bfs_search_3.Visited,
    Tolerance=Slider(0.0001, range=0..0.0001))  # -> Result, FailedInfo
assert_point_list_29 = AssertPointList(
    TestName="BFSSearchMilimeters_1GraphEdgeUndirectedStart0_Visited",
    ExpectedPointList=pt_139,
    ActualPointList=bfs_search_4.Visited,
    Tolerance=Slider(0.0001, range=0..0.0001))  # -> Result, FailedInfo
crv_15 = Curve(deconstruct_graph_14.Edges)
assert_point_list_30 = AssertPointList(
    TestName="BFSSearchMilimeters_TriangleStart0_Visited",
    ExpectedPointList=pt_140,
    ActualPointList=bfs_search_5.Visited,
    Tolerance=Slider(0.0001, range=0..0.0001))  # -> Result, FailedInfo
assert_list_25 = AssertList(TestName="BFSSearchMilimeters_TriangleStart0_PreviousArray", ExpectedList=txt_45, ActualList=bfs_search_5.PreviousArray)  # -> Result, FailedInfo
panel_47 = Panel(bfs_search_5.PreviousArray)
entwine_20 = Entwine(
    Branch00=assert_point_list_28.Result,
    Branch01=assert_list_22.Result,
    Branch02=assert_point_list_27.Result,
    Branch03=assert_list_24.Result,
    Branch04=assert_point_list_29.Result,
    Branch05=assert_list_23.Result,
    Branch06=assert_point_list_30.Result,
    Branch07=assert_list_25.Result,
    FlattenInputs=True)  # -> flatten(Result)

# ----
# Result:
total = Total(Results=flatten([entwine_3, entwine_2, entwine, entwine_9, entwine_14, entwine_15, entwine_16, entwine_17, entwine_18, entwine_19, entwine_20]))  # -> TotalResult, ReportPart
panel_48 = Panel(total.TotalResult)

# ----
# Export report:
# Table of contents:
# Curve To Graph Part
# Two Points To Graph Part
# Vector To Graph Part
# Create Graph
# Mesh To Graph
# Graph To Report Part
# Get Closest Vertex
create_report = CreateReport(ReportParts=[calendar, total.ReportPart], TableOfContents=False)
path = FilePath("C:\Users\code-structures\Desktop\Projekty\2020_12_03_Megarachne\Megarachne\Megarachne\Megarachne\TestsInsideGrasshopper\Report.md")  # disabled
# Unit Tests inside Grasshopper
# 
# Required plugins:
# - Megarachne
# - Pterodactyl
# - Brontosaurus
save_report = SaveReport(Report=create_report, Path=path)  # disabled
